# Grasshopper definition Belt_PDF_Linker.gh (Grasshopper 1.0.7)
# plug-ins: Hops

details = Panel("'XC-001','XC-A101','XC-D101', 'XC-A201', 'XC-A501','XC-A502','XC-A503','XC-A504','XC-A505','XC-A506', 'XC-D501', 'XC-D502'")
pdf_name = Panel("SCOTTSDALE_ZAHNER_100CD_SET_V3")
details_2 = Panel("""XZ-200
XC-001
XC-A101
XC-D101
XC-A201
XC-A501
XC-A502
XC-A503
XC-A504
XC-A505
XC-A506
XC-D501
XC-D502""")
pdf_name_2 = Panel("SCOTTSDALE_360_Canopy_Submittal_20220511")
details_3 = Panel("""Z10.1
Z11.1
Z20.1
Z20.2
Z40.1
Z40.2
Z40.3""")
text_to_ignore = Panel("""ectppr
gh4b0.nb0
projpojpjj
cldsgniasswnh0
oftosicdalfocd
1htanwrsarig1blap
swhbfi
ecthxpr
eschutcheon
shiwnyl4fntniscwbl0n3n
swhbfi
ecthxpu
shiwnyl4fntnh0calgn
swhbfi
ecthxpv
eschutcheon
shiwnyl4fntnwz2n6s22n
swhbf
ecthxpx
shiwnyl4fntnyhc:n:0b-sns
ecthxpu
shiwnyl4fntnh0calgn
ecthxp
shiwnyl4fntn4b0.n4hffn6s22n
ecthxpj
shiwnyl4fntn4b0.n4hffn2fh0n
ecthxpr
shiwnyl4fntniscwbl0n3n
ecthrpr
shiwnyl4fn2fh0
ecthjpr
shiwnyl4fn4siwnsfsdhwbl0""")
# Graveyard of attempts to HTTP requests in grasshopper
toggle = BooleanToggle(False)
cset = CreateSet(List=details_3)  # -> Set, Map
cset_2 = CreateSet(List=text_to_ignore)  # -> Set, Map

# ---- group: InputFormat
concat = Concatenate(FragmentA="'", FragmentB=cset.Set, FragmentC="'")  # -> flatten(Result)
join = TextJoin(Text=concat, Join=",")

concat_2 = Concatenate(FragmentA="'", FragmentB=cset_2.Set, FragmentC="'")  # -> flatten(Result)
join_2 = TextJoin(Text=concat_2, Join=",")

# ----
# RUN B.E.L.T
pdf_to_operate_on_location = Panel("C:\Box\Engineering\parametric{COLAB}\_Tools\200_SubmittalTools\pdfLinks")
download = BooleanToggle(False)
run_upload = GhPythonScript(run=download, pathToFilePdf=pdf_to_operate_on_location, PdfName=pdf_name_2, detailsToLink=join, ignore=join_2)  # -> out, done; inputs run: Boolean
# ---------- run_upload: Python ----------
"""
    runs belt the pdfer post processing
    subprocess example here: https://code.luasoftware.com/tutorials/python/simple-guide-to-subprocess/
"""

__author__ = "nbarnes"
__version__ = "2021.09.28"


import subprocess, os, platform
import sys
sys.path.append(r'C:/')


# import upload
# belt - bifricating, examining, l, teamwork

belt = r'C:/Box/Engineering/parametric{COLAB}/_Tools/200_SubmittalTools/linkPages.py'

if run:
    print pathToFilePdf.replace('\\', '/'), '\n', PdfName 
    fixPath = pathToFilePdf.replace('\\', '/')
#    proc = subprocess.Popen(['python ', belt, pathToFilePdf, PdfName, detailsToLink, ignore ], stdout=subprocess.PIPE, stderr=subprocess.PIPE) #having shell=true seems to prevent running
#    print proc
#    stdout_value2 = proc.communicate()
#    print '\tstdout2:', stdout_value2
    
    try:
        proc = subprocess.Popen(['python ', belt, pathToFilePdf, PdfName, detailsToLink, ignore ], stdout=subprocess.PIPE, stderr=subprocess.PIPE)
    except:
        proc = subprocess.Popen(['py ', belt, pathToFilePdf, PdfName, detailsToLink, ignore ], stdout=subprocess.PIPE, stderr=subprocess.PIPE)
        
    stdout_value2 = proc.communicate()
    print '\tstdout2:', stdout_value2
    
    
    
    
    
    
#    subprocess.call(['python', pythonUpload, pathToFile, fileName], shell=True, stdout=subprocess.PIPE,)
#    proc = subprocess.Popen(['python', pythonUpload, fixPath, fileName], shell=True, stdin=subprocess.PIPE, stdout=subprocess.PIPE,)

#    pipe_stdout = os.popen('python ' + pythonUpload + ' ' + fixPath + ' ' + fileName, 'r')
#    try:
#        stdout_value = pipe_stdout.read()
#    finally:
#        pipe_stdout.close()
#    print '\tstdout:', repr(stdout_value)
    
#    stdout_value = proc.communicate()[0]
#    print '\tstdout:', repr(stdout_value)
#    subprocess.Popen([pythonUpload, pathToFile, fileName])
# ---------- end run_upload ----------

# ----
# C:\Users\nbarnes\Documents\GitHub\Vention-Motion\mm-python-api-2.1\start.py
# C:\Users\nbarnes\Documents\GitHub\Vention-Motion\mm-python-api-2.1\examples\emitAbsoluteMove.py
# C:\Users\nbarnes\Documents\GitHub\Vention-Motion\mm-python-api-2.1\app.py
# C:\Users\nbarnes\Documents\GitHub\Vention-Motion\mm-python-api-2.1\examples\emitHome.py
# C:\Users\nbarnes\Documents\GitHub\Vention-Motion\mm-python-api-2.1\examples\configAxis.py
# C:\Users\nbarnes\Documents\GitHub\Vention-Motion\mm-python-api-2.1\examples\emitRelativeMove.py
concat_3 = Concatenate(FragmentA=pdf_to_operate_on_location, FragmentB="\", FragmentC=details_3, FragmentD=".json")
data = Data(concat_3)
panel = Panel("http://127.0.0.1:5000/help")
# working! need to add an upload of pdf and store for app to use
panel_2 = Panel("http://127.0.0.1:5000/pdfering")
# https://pdf-linking.herokuapp.com/pdfering
toggle_2 = BooleanToggle(False)
pdf_location = Data(pdf_to_operate_on_location)
rep = ReplaceText(Text=pdf_location, Find="\", Replace="/", RecursiveReplace=False)
name = Data(pdf_name_2)
c_script = CSharpScript(SendFile=toggle, pdfLinkFolder=pdf_location, pdfName=name)  # -> out, A; inputs SendFile: Boolean, pdfLinkFolder: String, pdfName: String; disabled
# ---------- c_script: C# usings ----------
using System.Net.Http;
# ---------- c_script: C# ----------
    // need to make https requests
    HttpClient client = new HttpClient();
    var pdfLink = pdfLinkFolder + '\\' + pdfName + '.pdf';
    //var url = "https://pdf-linking.herokuapp.com/upload";
    var url = "http://127.0.0.1:5000/upload";
    
    var values = new Dictionary<string, string>
      {
        {"file", {pdfLink,f}},
        };
    
    if (SendFile){
      var content = new FormUrlEncodedContent(values);

      var response = client.PostAsync(url, content);

      var responseString = response.Content.ReadAsStringAsync();
    }
# ---------- end c_script ----------
python = GhPythonScript(SendFile=toggle, pdfLinkFolder=pdf_location, pdfName=name)  # -> out, a; inputs SendFile: Boolean; disabled
# ---------- python: Python ----------
__author__ = "nbarnes"
__version__ = "2022.08.30"

import rhinoscriptsyntax as rs
#import requests

if (SendFile):
    pdfLink = pdfLinkFolder + '\\' + pdfName + '.pdf'
    f = open(pdfLink, 'rb')
    print f
    headers={'Username': 'abc@gmail.com', 'apikey':'123-456'}

    f = open(pdfLink, 'rb')
    files = {"file": (pdfLink, f)}
    # resp = requests.post("http://127.0.0.1:5000/upload", files=files, headers=headers )
    resp = requests.post("https://pdf-linking.herokuapp.com/upload", files=files, headers=headers )
    print (resp.text)
# ---------- end python ----------
details_4 = Data(join)
details_ignore = Data(join_2)
panel_3 = Panel(name)
hops = Hops(
    Run=Toggle(False),
    PdfFolder=pdf_location,
    PdfNamer=name,
    Details=details_4,
    IgnorDetails=details_ignore,
    CacheResultsInMemory=False,
    CacheSolveResults=False,
    RemoteDefinitionLocation="http://127.0.0.1:5000/pdfering",
    RemoteSolveVersion=(0, 1, 0),
    ShowInput_Enabled=False,
    ShowInput_Path=False,
    SynchronousSolve=False)
python_2 = GhPythonScript(LaunchUpload=Toggle(False))  # -> out, a; inputs LaunchUpload: Boolean
# ---------- python_2: Python ----------
__author__ = "nbarnes"
__version__ = "2022.08.30"

import rhinoscriptsyntax as rs
import webbrowser
#import requests

if (LaunchUpload):
    webbrowser.open('https://pdf-linking.herokuapp.com/upload', new=2)
#    webbrowser.open_new_tab('https://pdf-linking.herokuapp.com/upload')
# ---------- end python_2 ----------
panel_4 = Panel("http://127.0.0.1:5000/BELT")
hops_2 = Hops(
    Run=toggle_2,
    PdfFolder=pdf_location,
    PdfNamer=name,
    Details=details_4,
    IgnorDetails=details_ignore,
    CacheResultsInMemory=False,
    CacheSolveResults=False,
    RemoteDefinitionLocation="https://pdf-linking.herokuapp.com/pdfer",
    RemoteSolveVersion=(0, 1, 0),
    ShowInput_Enabled=False,
    ShowInput_Path=False,
    SynchronousSolve=False)
panel_5 = Panel(hops_2)
panel_6 = Panel(hops)
panel_7 = Panel(run_upload.out)
