# Grasshopper definition pdfer.gh (Grasshopper 1.0.7)
# plug-ins: Hops

panel = Panel("""C:\Box\Engineering\parametric{COLAB}\_Tools\200_SubmittalTools\pdfLinks\

SCOTTSDALE_360_Canopy_Submittal_20220511.pdf""")
# https://pdf-linking.herokuapp.com/pdfer
toggle = BooleanToggle(False)
pdf_location = Data("C:\Box\Engineering\parametric{COLAB}\_Tools\200_SubmittalTools\pdfLinks")
name = Data("SCOTTSDALE_360_Canopy_Submittal_20220511")
details = Data("'Z10.1','Z11.1','Z20.1','Z20.2','Z40.1','Z40.2','Z40.3'")
details_ignore = Data("'ectppr','gh4b0.nb0','projpojpjj','cldsgniasswnh0','oftosicdalfocd','1htanwrsarig1blap','swhbfi','ecthxpr','eschutcheon','shiwnyl4fntniscwbl0n3n','ecthxpu','shiwnyl4fntnh0calgn','ecthxpv','shiwnyl4fntnwz2n6s22n','swhbf','ecthxpx','shiwnyl4fntnyhc:n:0b-sns','ecthxp','shiwnyl4fntn4b0.n4hffn6s22n','ecthxpj','shiwnyl4fntn4b0.n4hffn2fh0n','ecthrpr','shiwnyl4fn2fh0','ecthjpr','shiwnyl4fn4siwnsfsdhwbl0'")
python = GhPythonScript(LaunchUpload=Toggle(False))  # -> out, a; inputs LaunchUpload: Boolean
# ---------- python: Python ----------
__author__ = "nbarnes"
__version__ = "2022.08.30"

import rhinoscriptsyntax as rs
import webbrowser
#import requests

if (LaunchUpload):
    webbrowser.open('https://pdf-linking.herokuapp.com/upload', new=2)
#    webbrowser.open_new_tab('https://pdf-linking.herokuapp.com/upload')
# ---------- end python ----------
hops = Hops(
    Run=toggle,
    PdfFolder=pdf_location,
    PdfNamer=name,
    Details=details,
    IgnorDetails=details_ignore,
    CacheResultsInMemory=False,
    CacheSolveResults=False,
    RemoteDefinitionLocation="https://pdf-linking.herokuapp.com/pdfer",
    RemoteSolveVersion=(0, 1, 0),
    ShowInput_Enabled=False,
    ShowInput_Path=False,
    SynchronousSolve=False)
panel_2 = Panel(hops)
